# Grasshopper definition io.gh (Grasshopper 1.0.7)

# Fixed lines
crv = Curve(<curve referenced from the Rhino model>)
# Input lines
crv_2 = Curve([<curve referenced from the Rhino model> x12])
# Layer lines
crv_3 = Curve([<curve referenced from the Rhino model> x4])
crv_4 = Curve([<curve referenced from the Rhino model> x4])
group = Group(Objects=crv_3)
group_2 = Group(Objects=crv_4)
group_3 = Group(Objects=[group, group_2])
# Send
button = Button()
python = GhPythonScript(lines=crv_2, radius="0.01", file_name="box", fixed_lines=crv, layers_lines=group_3, button=button)  # inputs lines: list of Curve, fixed_lines: list of Curve, button: Boolean
# ---------- python: Python ----------
import time
import ghpythonlib.components as gh
from compas_eve import Message
from compas_eve import Publisher
from compas_eve import Topic
from compas_eve.mqtt import MqttTransport


def get_line_id(line, lines):
    [p0, p1] = gh.EndPoints(line)
    
    for id, l in enumerate(lines):
        [q0, q1] = gh.EndPoints(l)
        dist0 = gh.Distance(p0, q0) + gh.Distance(p1, q1)
        dist1 = gh.Distance(p1, q0) + gh.Distance(p0, q1)
        if dist0 < 1E-6 or dist1 < 1E-6:
            return id

if button:
    topic = Topic("/scaffold/stick_model/", Message)
    tx = MqttTransport(host="localhost")
    publisher = Publisher(topic, transport=tx)
    
    data = {"radius": 0.01,
    "vertices": [],
    "edges": [],
    "file_name": file_name,
    "fixed_element_inds": [],
    "layers_ind": []
    }
    
    
    for line in lines:
        [p0, p1] = gh.EndPoints(line)
        nV = len(data["vertices"])
        data["vertices"].append([x for x in p0])
        data["vertices"].append([x for x in p1])
        data["edges"].append([nV, nV + 1])
    
    remain_inds = range(len(lines))
    
    if layers_lines != None:
    
        for layer in layers_lines:
            layer_ind = []
            for line in layer:
                ind = get_line_id(line, lines)
                layer_ind.append(ind)
                remain_inds.remove(ind)
            data["layers_ind"].append(layer_ind)
    if remain_inds != []:
            data["layers_ind"].append(remain_inds)
    
    for line in fixed_lines:
        ind = get_line_id(line, lines)
        data["fixed_element_inds"].append(ind)
    
    msg = Message(data)
    publisher.publish(msg)
    time.sleep(1)
# ---------- end python ----------
# Receiver
bg_task = BackgroundTask(reset=Button(), on=Toggle(True))  # -> result; inputs on: Boolean
#   port reset: Resets the background worker.
#   port on: Turn ON or OFF the background worker.
#   port result: The result of the long-running task.
# ---------- bg_task: Python ----------
"""
Background Task component.

Executes a long-running task in the background, while keeping Grasshopper reactive.

COMPAS EVE v0.3.0
"""
import threading
import scriptcontext as sc

import time
from compas_eve.ghpython import BackgroundWorker
from ghpythonlib.componentbase import executingcomponent as component
from compas_eve import Message
from compas_eve import Subscriber
from compas_eve import Topic
from compas_eve.mqtt import MqttTransport

DEBUG = False
result = []
def func(msg):
    global result
    result.append(msg)

def task(worker):
    global result
    result = []

    topic = Topic("/opt/scaffold_model/", Message)
    tx = MqttTransport("localhost")

    subcriber = Subscriber(topic, callback=func, transport=tx)
    subcriber.subscribe()
    
    for id in range(0, 100):
        worker.update_result(result)
        time.sleep(1.0)
        worker.display_message("Reciever end in {}s".format(100 - id))
    
    worker.display_message("Done!")
    subcriber.unsubscribe()
    return result

class BackgroundTaskComponent(component):
    def RunScript(self, reset, on):
        if not on:
            BackgroundWorker.stop_instance_by_component(ghenv)  # noqa: F821
            return None

        self.worker = BackgroundWorker.instance_by_component(ghenv, task, force_new=reset)  # noqa: F821

        if not self.worker.is_working() and not self.worker.is_done() and reset:
            self.worker.start_work()

        print("Worker ID: {}".format(id(self.worker)))
        print("Is worker running? {}".format(self.worker.is_working()))
        print("Worker completed? {}".format(self.worker.is_done()))
        if hasattr(self.worker, "thread"):
            print("Worker thread: {}".format(self.worker.thread))

        if DEBUG:
            other_workers = []
            for key in sc.sticky.keys():
                if key.startswith("background_worker_"):
                    worker = sc.sticky[key]
                    if worker != self.worker:
                        other_workers.append(worker)

            if len(other_workers):
                print
                print("Found {} more workers:".format(len(other_workers)))
                for worker in other_workers:
                    print("* Worker ID: {}".format(id(worker)))
                    print(" - Is worker running? {}".format(worker.is_working()))
                    print(" - Worker completed? {}".format(worker.is_done()))
                    print(" - Worker thread: {}".format(worker.thread))

            non_main_threads = [thread for thread in threading.enumerate() if thread.name != "MainThread"]
            if len(non_main_threads):
                print
                print("Found {} background threads running:".format(len(non_main_threads)))
                for thread in non_main_threads:
                    print(" - " + thread.name)

        if hasattr(self.worker, "result"):
            return self.worker.result
        else:
            return None
# ---------- end bg_task ----------
python_2 = GhPythonScript(x=bg_task)  # -> out, a; inputs x: list
# ---------- python_2: Python ----------
__author__ = "wangziqi"

import rhinoscriptsyntax as rs

out = len(x)
print(out)
# ---------- end python_2 ----------
panel = Panel(python_2.out)
item = ListItem(Index="-2", Wrap=True)
beams = GhPythonScript(json_data=item)  # -> beams
# ---------- beams: Python ----------
__author__ = "wangziqi"

import rhinoscriptsyntax as rs
import ghpythonlib.components as gh
beams = []
#print(json_data)
for line_data in json_data["line"]:
    [p0, p1] = line_data
    v0 = gh.ConstructPoint(p0[0], p0[1], p0[2])
    v1 = gh.ConstructPoint(p1[0], p1[1], p1[2])
    zaxis = v1 - v0
    length = gh.VectorLength(zaxis)
    plane = gh.PlaneNormal(v0, zaxis)
    cylinder = gh.Cylinder(plane, json_data["radius"], length)
    beams.append(cylinder)
# ---------- end beams ----------
